test file "myEncoderSmokeTest"

suite "New Test Suite 1"

  case "SmokeTest" [baseline]
    model MidSideProcessor_Solution, start time 0, stop time 2
    logged signals "Signal Set 1": stereoSndOut, stereoSndIn
    post-load callback:
      set_param('MidSideProcessor_Solution/Width', 'Value', '1');
      set_param('MidSideProcessor_Solution/Audio Output', 'Commented', 'on');
    baseline "smokeTestData.mat"
      stereoSndOut
      stereoSndIn
      Width:Value